# Grasshopper definition Camera.gh (Grasshopper 1.0.7)

mesh = Mesh(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)
cir = Circle(Plane="0, 0, 5", Radius="10")
pt = Point(Point(0, 0.02887044388, 1.821838863))
eval = EvaluateCurve(Curve=reparameterize(cir), Parameter=Slider(0.673, range=0..1))  # -> Point, Tangent, Angle
python = PythonScript(ICameraTarget=pt, ICameraLocation=eval.Point)  # -> Out, OGeometry
