# Grasshopper definition CameraInfo.gh (Grasshopper 1.0.7)

# Format Engineers CAD Information Issue Disclaimer
# 
# Project: PROJECT NAME
# 
# You should use this model for reference purposes only to assist in co-ordinating your work and is supplementary to formally issued drawings. Once the data is introduced into your own CAD or other system Format Engineers Ltd. can take no responsibility for its accuracy.
# 
# The last set of formally issued paper drawings are the contractual documents which represent the current stage of design development. If you have any queries, please contact the project CAD co-ordinator or the CAD Development Team.
# 
# Changes:
# 
# YYYY-MM-DD: Summary of changes
# 
# Usage notes:
# 
# This definition includes a basic implementation of Merbarki's Farthest Point Seeding algorithm (2005), adapted for tracing lines of principal curvature on NURBS surfaces. Requires modified Triangle.NET, if this isn't attached then... good luck! There are currently two main limitations: (a) this implementation measures density in parameter space, and (b) it doesn't include the dynamic refinement of density that Mebarki suggests.
boolean_toggle = BooleanToggle(True)
getcam = GetCamera(A=boolean_toggle)  # -> out, S, T, L, U
# ---------- getcam: Python ----------
"""
Gets active Rhino camera.
    Inputs:
        A: Set to 'True' to activate current camera.
    Outputs:
        S: Starting location.
        T: Target location.
        L: Lens length.
        U: Up.
"""

ghenv.Component.Name = "Get Camera"
ghenv.Component.NickName = 'GetCam'

# Import libraries.
import Rhino
import Grasshopper as gh

# Warnings.
if not A:
        msg = "Input parameter 'A' failed to collect data."
        ghenv.Component.AddRuntimeMessage(gh.Kernel.GH_RuntimeMessageLevel.Warning, msg)

if A == True:
    S = Rhino.RhinoDoc.ActiveDoc.Views.ActiveView.ActiveViewport.CameraLocation
    T = Rhino.RhinoDoc.ActiveDoc.Views.ActiveView.ActiveViewport.CameraDirection
    L = Rhino.RhinoDoc.ActiveDoc.Views.ActiveView.ActiveViewport.Camera35mmLensLength
    U = Rhino.RhinoDoc.ActiveDoc.Views.ActiveView.ActiveViewport.CameraUp
# ---------- end getcam ----------
