# Grasshopper definition ChainKinematics.gh (Grasshopper 1.0.7)

pt = Point([Point(0.7434905853, -0.6953769703, 0), Point(1.664974702, 1.731197869, 0), Point(4.798020697, 3.389869279, 0), Point(8.668253986, 4.096340435, 0), Point(12.78421637, 3.512733828, 0), Point(15.67153327, 2.406952888, 0)])
python = GhPythonScript(
    iPivots=pt,
    iAngles=[Slider(-0.207, range=-2..2), Slider(0.249, range=-2..2), Slider(0.563, range=-2..2), Slider(0.202, range=-2..2), Slider(0.081, range=-2..2)])  # -> out, oResult; inputs iPivots: list of Point3d, iAngles: list
# ---------- python: Python ----------
import Rhino.Geometry as rg

for i in range(len(iPivots) - 1):
    rotation = rg.Transform.Rotation(iAngles[i], rg.Vector3d.ZAxis, iPivots[i])
    for j in range(i+1, len(iPivots)):
        pivot = iPivots[j]
        pivot.Transform(rotation)
        iPivots[j] = pivot
        
oResult = iPivots
# ---------- end python ----------
pline = PolyLine(Vertices=python.oResult, Closed=False)
