# Grasshopper definition DataTree.gh (Grasshopper 1.0.7)

pt = Point([Point(-5.833119089, -11.98187755, 1.33861835), Point(-6.007495781, -4.138642626, 0.1259608313), Point(-6.202023116, 2.836186403, 1.394351571), Point(-6.287105486, 11.54453891, 0)])
pt_2 = Point([Point(1.913171553, -12.37762598, 0.1974349065), Point(1.930858662, -4.138642626, 1.090949614), Point(1.532677656, 2.836186403, 0), Point(1.948500782, 10.93562687, 1.219364947)])
# McNeel Barcelona Training Course
# Python Scripting for Grasshopper
# April 8-12, 2019
# Long Nguyen & Thu Nguyen-Phuoc-Ha
pt_3 = Point([Point(-14.26346322, -11.45402818, 1.462858435), Point(-14.76511358, -4.138642626, 1.141989799), Point(-14.90049129, 2.836186403, 2.612322126), Point(-13.55397943, 10.63056885, 0.889845503)])
pt_4 = Point([Point(8.298819237, -11.45402818, 1.351663361), Point(8.696214059, -4.138642626, 0.7165188661), Point(9.408234319, 2.836186403, 1.423925018), Point(9.138919057, 10.63056885, 1.820715933)])
entwine = Entwine(Branch00=pt_3, Branch01=pt, Branch02=pt_2, Branch03=pt_4, FlattenInputs=True)
# Create a LIST of spheres from a TREE of points
python = GhPythonScript(iPointTree=entwine)  # -> out, oSpheres; inputs iPointTree: tree of Point3d
# ---------- python: Python ----------
import Rhino.Geometry as rg

spheres = []

for points in iPointTree.Branches:
    for point in points:
        spheres.append(rg.Sphere(point, 2.0));

oSpheres = spheres;
# ---------- end python ----------
# Remove some paths according to a rule
python_2 = GhPythonScript(iPointTree=entwine)  # -> out, oGeometry; inputs iPointTree: tree of Point3d
# ---------- python_2: Python ----------
import Rhino.Geometry as rg
from Grasshopper import *
from Grasshopper.Kernel.Data import *

for i in range(0, 10, 2):
    path = GH_Path(0, i)
    iPointTree.RemovePath(path)

oGeometry = iPointTree
# ---------- end python_2 ----------
# Remove a specific path from a tree
python_3 = GhPythonScript(iPointTree=entwine)  # -> out, oGeometry; inputs iPointTree: tree of Point3d
# ---------- python_3: Python ----------
import Rhino.Geometry as rg
from Grasshopper import *
from Grasshopper.Kernel.Data import *

path = GH_Path(0, 1)

iPointTree.RemovePath(path)

oGeometry = iPointTree
# ---------- end python_3 ----------
# Create a TREE of spheres from a TREE of points, maintaining the same structures between two trees
python_4 = GhPythonScript(iPointTree=entwine)  # -> out, oSpheres; inputs iPointTree: tree of Point3d
# ---------- python_4: Python ----------
import Rhino.Geometry as rg
from Grasshopper import *

sphereTree = DataTree[rg.Sphere]()

for path in iPointTree.Paths:
    points = iPointTree.Branch(path)
    spheres = []
    for point in points:
        spheres.append(rg.Sphere(point, 2.0));
    sphereTree.AddRange(spheres, path)

oSpheres = sphereTree;
# ---------- end python_4 ----------
# Generate a new tree from scratch
python_5 = GhPythonScript()  # -> out, oGeometry
# ---------- python_5: Python ----------
import Rhino.Geometry as rg
from Grasshopper import *
from Grasshopper.Kernel.Data import *

pointTree = DataTree[rg.Point3d]()

for i in range(0, 10):
    for j in range(0, 10):
        path = GH_Path(i, j)
        point = rg.Point3d(i, j, 0)
        pointTree.Add(point, path)
        
oGeometry = pointTree
# ---------- end python_5 ----------
