# Grasshopper definition ListWeaving.gh (Grasshopper 1.0.7)

python = GhPythonScript()  # -> out, oResult
# ---------- python: Python ----------
firstList = ["a"] * 20
secondList = ["b"] * 20
thirdList = ["c"] * 20

allLists = [firstList, secondList, thirdList]

weavingPattern = [0, 0, 2, 1]

cursors = [0] * len(allLists)

result = []

while True:
    if cursors[0] >= len(allLists[0]) or cursors[1] >= len(allLists[1]) or cursors[2] >= len(allLists[2]):
        break
    for i in weavingPattern:
        item = allLists[i][cursors[i]]
        result.append(item)
        cursors[i] += 1
    
oResult = result
# ---------- end python ----------
panel = Panel(python.oResult)
