# Grasshopper definition MeshMouseManipulation.gh (Grasshopper 1.0.7)
# plug-ins: Mouse Tracker

mouse = MouseTracker(On=Toggle(True))  # -> MouseLine, MousePositionPixels, MousePositionFraction, LeftMousePressed
mesh = Mesh(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)
timer = Timer(TimerInterval=1, Target=python)  # disabled
python = PythonScript(
    IReset=Button(),
    IMesh=mesh,
    IMouseLine=mouse.MouseLine,
    ILeftClick=mouse.LeftMousePressed,
    IBrushRadius=Slider(0.24, range=0..0.5))  # -> Out, OGeometry
panel = Panel(python.Out)
