# Grasshopper definition MeshMouseManipulation_Completed.gh (Grasshopper 1.0.7)
# plug-ins: Mouse Tracker

mouse = MouseTracker(On=Toggle(True))  # -> MouseLine, MousePositionPixels, MousePositionFraction, LeftMousePressed
mesh = Mesh(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)
timer = Timer(TimerInterval=1, Target=python)  # disabled
python = PythonScript(
    iReset=Button(),
    iMesh=mesh,
    iMouseLine=mouse.MouseLine,
    iLeftClick=mouse.LeftMousePressed,
    iBrushRadius=Slider(0.5, range=0..0.5))  # -> out, oGeometry; inputs iReset: Boolean, iMesh: Mesh, iMouseLine: Line, iLeftClick: Boolean
# ---------- python: Python ----------
import Rhino.Geometry as rg
import Rhino
from Rhino.Geometry.Intersect import Intersection
from System.Drawing import Color

if iReset:
    mesh = iMesh
    for i in range(iMesh.Vertices.Count):
        mesh.VertexColors.SetColor(i, Color.Black)
else:
    if iLeftClick:
        
        # Find the mouse hit point ============
        
        hitPoints = Intersection.MeshLine(mesh, iMouseLine)[0]
        if len(hitPoints) > 0: 
            closestHitPoint = hitPoints[0]
            cameraLocation = Rhino.RhinoDoc.ActiveDoc.Views.ActiveView.ActiveViewport.CameraLocation
            for hitPoint in hitPoints:
                if hitPoint.DistanceTo(cameraLocation) < closestHitPoint.DistanceTo(cameraLocation):
                    closestHitPoint = hitPoint
    
        # Add some redness to the vertices that are near to the hit point ======
        
        for i in range(mesh.Vertices.Count):
            vertex = rg.Point3d(mesh.Vertices[i])
            if vertex.DistanceTo(closestHitPoint) > iBrushRadius: continue
            newRed = mesh.VertexColors[i].R + 12
            if newRed > 255: newRed = 255
            mesh.VertexColors.SetColor(i, Color.FromArgb(newRed, 0, 0))
            
    # Decay Colors ====================
    
    for i in range(mesh.Vertices.Count):
        newRed = mesh.VertexColors[i].R * 0.99
        if newRed > 255: newRed = 255
        mesh.VertexColors.SetColor(i, Color.FromArgb(newRed, 0, 0))
            
oGeometry = mesh
# ---------- end python ----------
