# Grasshopper definition MeshVertexColorPainting.gh (Grasshopper 1.0.7)
# plug-ins: Mouse Tracker

mouse = MouseTracker(On=Toggle(True))  # -> MouseLine, MousePositionPixels, MousePositionFraction, LeftMousePressed
mesh = Mesh(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)
python = PythonScript(IMesh=mesh, IMouseLine=mouse.MouseLine, IMousePressed=mouse.LeftMousePressed, IReset=Button())  # -> Out, OHitPoint, OMesh
timer = Timer(TimerInterval=1, Target=python)  # disabled
