# Grasshopper definition MeshVertexColorPainting_Completed.gh (Grasshopper 1.0.7)
# plug-ins: Mouse Tracker

mouse = MouseTracker(On=Toggle(True))  # -> MouseLine, MousePositionPixels, MousePositionFraction, LeftMousePressed
mesh = Mesh(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)
flip = FlipCurve(Curve=mouse.MouseLine)  # -> Curve, Flag
timer = Timer(TimerInterval=1, Target=python)  # disabled
python = PythonScript(IMesh=mesh, IMouseLine=flip.Curve, IMousePressed=mouse.LeftMousePressed, IReset=Button())  # -> Out, OHitPoint, OMesh
sph = Sphere(Base=python.OHitPoint, Radius=0.3)
