# Grasshopper definition MeshVertexPainting.gh (Grasshopper 1.0.7)
# plug-ins: Mouse Tracker

mouse_tracker = MouseTracker(On=Toggle(True))  # -> MouseLine, MousePositionPixels, MousePositionFraction, LeftMousePressed
mesh = Mesh(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)
timer = Timer(TimerInterval=1, Target=python)
python = PythonScript(iMesh=mesh, iMouseLine=mouse_tracker.MouseLine, iMousePressed=mouse_tracker.LeftMousePressed, iReset=Button())  # -> out, oHitPoint, oMesh; inputs iMesh: Mesh, iMouseLine: Line, iMousePressed: Boolean, iReset: Boolean
# ---------- python: Python ----------
import Rhino.Geometry as rg
from Rhino.Geometry.Intersect import Intersection
from System.Drawing import Color

if iReset:
    myMesh = iMesh.Duplicate()
    for i in range(iMesh.Vertices.Count):
        myMesh.VertexColors.SetColor(i, Color.Black)
        
else:

    # Fade the vertex colors:

    for i in range(myMesh.Vertices.Count):
        newRed = myMesh.VertexColors[i].R * 0.999
        myMesh.VertexColors.SetColor(i, Color.FromArgb(newRed, 0 ,0))

    # Finding the mouse hit point:
    
    hitPoints = Intersection.MeshLine(iMesh, iMouseLine)[0]
    
    if len(hitPoints) > 0:
        
        nearestHitPoint =  hitPoints[0]
        for hitPoint in hitPoints:
            if nearestHitPoint.DistanceTo(iMouseLine.From) > hitPoint.DistanceTo(iMouseLine.From):
                nearestHitPoint = hitPoint
        
        oHitPoint = nearestHitPoint
    
    # Add red amount to the vertices near the mouse hit point:
    
    if iMousePressed:
        for i in range(myMesh.Vertices.Count):
            if rg.Point3d(myMesh.Vertices[i]).DistanceTo(nearestHitPoint) < 0.3:
                newRed = myMesh.VertexColors[i].R + 8
                if newRed > 255: newRed = 255
                myMesh.VertexColors.SetColor(i, Color.FromArgb(newRed, 0 ,0))
     
    
        
oMesh = myMesh
# ---------- end python ----------
