# Grasshopper definition MovingPointWithRandomDirection_WithMouseInteraction.gh (Grasshopper 1.0.7)
# plug-ins: Mouse Tracker

timer = Timer(TimerInterval=50, Target=[ghpython_script_2, ghpython_script_3])  # disabled
button = Button()
ghpython_script = GhPythonScript(iReset=button)  # -> out, oGeometry; inputs iReset: Boolean; disabled
# ---------- ghpython_script: Python ----------
import Rhino.Geometry as rg
import random

if iReset:
    movingPoint = rg.Point3d(0, 0, 0)
    displacement = rg.Vector3d(0.2, 0, 0)
    history = [movingPoint]
else:
    displacement.Rotate(random.uniform(-0.3, 0.3), rg.Vector3d.ZAxis)
    movingPoint += displacement
    
    if movingPoint.X > 10:
        movingPoint = rg.Point3d(0, movingPoint.Y, 0)
    elif movingPoint.X < 0:
        movingPoint = rg.Point3d(10, movingPoint.Y, 0)
    
    history.append(movingPoint)
    
oGeometry = history
# ---------- end ghpython_script ----------
ghpython_script_2 = GhPythonScript(iReset=button)  # -> out, oGeometry; inputs iReset: Boolean; disabled
# ---------- ghpython_script_2: Python ----------
import Rhino.Geometry as rg
import Rhino
import random

if iReset:
    movingPoint = rg.Point3d(0, 0, 0)
    displacement = rg.Vector3d(0.2, 0, 0)
    history = [movingPoint]
else:
    displacement.Rotate(random.uniform(-0.3, 0.3), rg.Vector3d.ZAxis)
    movingPoint += displacement
    
    if movingPoint.X > 10 or movingPoint.X < 0:
        displacement = rg.Vector3d(-displacement.X, displacement.Y, 0)
        
    history.append(movingPoint)
    
    Rhino.RhinoDoc.ActiveDoc.Views.ActiveView.ActiveViewport.SetCameraLocation(movingPoint, movingPoint + rg.Vector3d(0, 0, 10))
    
oGeometry = history
# ---------- end ghpython_script_2 ----------
ghpython_script_3 = GhPythonScript(iReset=button, iJerkiness=Slider(0.5, range=0..0.5))  # -> out, oGeometry; inputs iReset: Boolean
# ---------- ghpython_script_3: Python ----------
import Rhino.Geometry as rg
import Rhino
import random

if iReset:
    movingPoint = rg.Point3d(0, 0, 0)
    displacement = rg.Vector3d(0.2, 0, 0)
    history = [movingPoint]
else:
    displacement.Rotate(random.uniform(-iJerkiness, iJerkiness), rg.Vector3d.ZAxis)
    movingPoint += displacement
    
    if movingPoint.X > 10 or movingPoint.X < 0:
        displacement = rg.Vector3d(-displacement.X, displacement.Y, 0)
        
    history.append(movingPoint)
    
    Rhino.RhinoDoc.ActiveDoc.Views.ActiveView.ActiveViewport.SetCameraLocation(movingPoint, movingPoint + rg.Vector3d(0, 0, 10))
    
oGeometry = history
# ---------- end ghpython_script_3 ----------
panel = Panel(ghpython_script_2.out)
mouse_tracker = MouseTracker(On=Toggle(True))  # -> MouseLine, MousePositionPixels, MousePositionFraction, LeftMousePressed
panel_2 = Panel(mouse_tracker.LeftMousePressed)
panel_3 = Panel(mouse_tracker.MouseLine)
sphere = Sphere(Base=PlaneXY(0, 0, 0), Radius=1)
