# Grasshopper definition ParallelComputation_WithTreeOutput.gh (Grasshopper 1.0.7)

pt = Point([Point(-1.739331192, -3.319022068, 0), Point(0.7578591322, -0.388352043, 0), Point(-3.246004038, 4.257662582, 0)])
python = GhPythonScript(iGuidePoints=pt, iCount="3000", iVariation=Slider(1.945, range=0..3))  # -> out, oCurves; inputs iGuidePoints: list of Point3d, iCount: Int32
# ---------- python: Python ----------
import Rhino.Geometry as rg
from Grasshopper.Kernel.Types import *
import random

curves = []

for i in range(iCount):
    controlPoints = []
    for guidePoint in iGuidePoints:
        controlPoints.append(guidePoint + rg.Point3d(random.uniform(-iVariation, iVariation), random.uniform(-iVariation, iVariation), random.uniform(-iVariation, iVariation)))
    curves.append(GH_Curve(rg.Curve.CreateInterpolatedCurve(controlPoints, 3)))

oCurves = curves
# ---------- end python ----------
mesh = Mesh(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)
# Non-Parallel
python_2 = GhPythonScript(iMesh=mesh, iCurves=python.oCurves)  # -> out, oResult; inputs iMesh: Mesh, iCurves: list of Curve
# ---------- python_2: Python ----------
from Rhino.Geometry.Intersect import Intersection
import time


allIntersections = []

startTime = time.time()

for curve in iCurves:
    allIntersections.extend(Intersection.MeshPolyline(iMesh, curve.ToPolyline(0.1, 0.1, 0.1, 0.1))[0])

endTime = time.time()

print endTime - startTime

oResult = allIntersections
# ---------- end python_2 ----------
# Parallel
python_3 = GhPythonScript(iMesh=mesh, iCurves=python.oCurves)  # -> out, oResult; inputs iMesh: Mesh, iCurves: list of Curve
# ---------- python_3: Python ----------
from Rhino.Geometry.Intersect import Intersection
import Rhino.Geometry as rg
import time
from ghpythonlib import parallel

from Grasshopper import DataTree
from Grasshopper.Kernel.Data import GH_Path

def ProcessOneCurve(curve):
    return Intersection.MeshPolyline(iMesh, curve.ToPolyline(0.1, 0.1, 0.1, 0.1))[0]

startTime = time.time()

intersectionLists = parallel.run(ProcessOneCurve, iCurves, False)

tree = DataTree[rg.Point3d]()

for i in range(len(intersectionLists)):
    intersectionList = intersectionLists[i]
    tree.AddRange(intersectionList, GH_Path(i))
    


oResult = tree
# ---------- end python_3 ----------
# Parallel (using Lambda notation)
python_4 = GhPythonScript(iMesh=mesh, iCurves=python.oCurves)  # -> out, oResult; inputs iMesh: Mesh, iCurves: list of Curve
# ---------- python_4: Python ----------
from Rhino.Geometry.Intersect import Intersection
import time
from ghpythonlib import parallel

startTime = time.time()

intersectionLists = parallel.run(lambda c : Intersection.MeshPolyline(iMesh, c.ToPolyline(0.1, 0.1, 0.1, 0.1))[0], iCurves, False)

allIntersections = []

for intersectionList in intersectionLists:
    allIntersections.extend(intersectionList)

endTime = time.time()

print endTime - startTime

oResult = allIntersections
# ---------- end python_4 ----------
mcx = MeshCurve(Mesh=mesh, Curve=python.oCurves)  # -> Points, Faces
panel = Panel(python_4.out)
panel_2 = Panel(python_2.out)
panel_3 = Panel(python_3.out)
