# Grasshopper definition ParticleSystem_Completed.gh (Grasshopper 1.0.7)

pt = Point([Point(0.1453333915, -7.868858448, -4.200370007), Point(-0.561224943, -1, 0), Point(2.02540952, 11, 5.316281991)])
pt_2 = Point([Point(13.79400225, -4.790892361, 0), Point(16.04419039, 4.635787251, -3.113435892), Point(12.9880559, 13.42230948, 3.973962414)])
pt_3 = Point([Point(-8, -7.377432149, 0), Point(-5.897327344, -1, 8.712464232), Point(-8, 11, 0)])
entwine = Entwine(Branch00=pt_3, Branch01=pt, Branch02=pt_2, FlattenInputs=True)
intcrv = Interpolate(Vertices=entwine, Degree=3, Periodic=False, KnotStyle=1)  # -> flatten(Curve), Length, Domain
loft = Loft(Curves=intcrv.Curve, Options={Adjust=False, Closed=False, LoftEnds=0, LoftSimp=0, LoftType=0, Rebuild=10, Refit=0.01})
surface_strength = Slider(2, range=0..3)
separation_strength = Slider(2, range=0..3)
separation_strength_2 = Slider(2, range=0..3)
timer = Timer(TimerInterval=1, Target=python)  # disabled
file = ReadFile(File="D:\Desktop\RhinoPythonScripts\HelloRhinoPython.py", PerLineParse=False)
pt_4 = Point([Point(2.32072223, 1.727203947, 0), Point(1.329880984, 2.433921956, 0), Point(1.328851787, 1.384919816, 0), Point(1.075430921, 0.5277129225, 0), Point(3.233784148, 1.012688682, 0), Point(3.37927385, 1.431622908, 0)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])
pt_5 = Point(Point(18.07553275, 9.192531231, 0))
python = GhPythonScript(
    Code=file,
    IReset=Button(),
    IInitialPositions=pt_4,
    ISeparationStrength=separation_strength,
    IAttractor=pt_5,
    IAttractorStrength=separation_strength_2,
    ISurface=loft,
    ISurfaceStrength=surface_strength)  # -> Out, OParticlePositions
cir = Circle(Plane=python.OParticlePositions, Radius=1)
