# Grasshopper definition PullCurveToSurface.gh (Grasshopper 1.0.7)

pt = Point([Point(-8, -12, 0), Point(-9.744231068, -2.604218722, 4.415609526), Point(-8, 11, 6.167311488)])
pt_2 = Point([Point(0.1453333915, -14.80514343, 6.996679771), Point(-0.561224943, -1, 9.656267604), Point(0.04462376078, 11, 5.316281991)])
pt_3 = Point([Point(7.456778476, -12, 0), Point(8.377067306, -1, -3.113435892), Point(7.520270272, 11, 3.973962414)])
entwine = Entwine(Branch00=pt, Branch01=pt_2, Branch02=pt_3, FlattenInputs=True)
intcrv = Interpolate(Vertices=entwine, Degree=3, Periodic=False, KnotStyle=1)  # -> flatten(Curve), Length, Domain
point = Point(Point(3.981789528, -6, 9.477928424))
circle = Circle(Plane=point, Radius=1)
ghpython_script = GhPythonScript(iCurves=intcrv.Curve, iCurveToBePulled=circle)  # -> out, oGeometry; inputs iCurves: list of Curve, iCurveToBePulled: Curve
# ---------- ghpython_script: Python ----------
import Rhino.Geometry as rg

myBreps = rg.Brep.CreateFromLoft(iCurves, rg.Point3d.Unset, rg.Point3d.Unset, rg.LoftType.Normal, False)
myBrep = myBreps[0]

pulledCurves = iCurveToBePulled.PullToBrepFace(myBrep.Faces[0], 0.001)
oGeometry = pulledCurves
# ---------- end ghpython_script ----------
panel = Panel(ghpython_script.oGeometry)
