# Grasshopper definition RandomColorsWithRussianRoulette.gh (Grasshopper 1.0.7)

python = GhPythonScript(iVariation=Slider(0.5, range=0..1))  # -> out, oGeometry, oColors
# ---------- python: Python ----------
import Rhino.Geometry as rg
import math
import random
import System.Drawing as drawing

points = []
random.seed(0)
colors = []

for i in range(0, 60):
    for j in range(0, 30):
        variation = 0.5 * (i / 59)
        x = i + variation * random.uniform(-1.0, 1.0)
        y = j + variation * random.uniform(-1.0, 1.0)
        points.append(rg.Point3d(x , y, 0))

        randomNumber = random.uniform(0.0, 1.0)
        if (randomNumber < (i / 59)):
            colors.append(drawing.Color.Blue)
        else:
            colors.append(drawing.Color.Red)
oGeometry = points
oColors = colors
# ---------- end python ----------
preview = CustomPreview(Geometry=python.oGeometry, Material=python.oColors)
