# Grasshopper definition Read3dmFile.gh (Grasshopper 1.0.7)

# Retrieve all objects in a given layer
# Batch Processing all 3dm files in a given folder
panel = Panel("Default")
sph = Sphere(Base=PlaneXY(0, 0, 0), Radius=1)
# Retrieve an object and its attribute
python = GhPythonScript()  # -> out, a; disabled
# ---------- python: Python ----------
from Rhino.FileIO import *

file = File3dm.Read(r"D:\Desktop\test.3dm")

allGeometries = []

for obj in file.Objects:
    allGeometries.append(obj.Geometry) 
    print file.AllLayers.FindIndex(obj.Attributes.LayerIndex).Name
    
a = allGeometries
# ---------- end python ----------
python_2 = GhPythonScript(iLayerName=panel)  # -> out, a; disabled
# ---------- python_2: Python ----------
from Rhino.FileIO import *

file = File3dm.Read(r"D:\Desktop\test.3dm")

allGeometries = []

objs = file.Objects.FindByLayer(iLayerName)

for obj in objs:
    allGeometries.append(obj.Geometry)

a = allGeometries
# ---------- end python_2 ----------
python_3 = GhPythonScript(iDirectoryName="D:\Desktop\", iGeometry=sph)  # -> out, a; inputs iGeometry: Mesh
# ---------- python_3: Python ----------
from Rhino.FileIO import File3dm
from Rhino.DocObjects import *
import os.path as path
import glob

# Search for all filenames that has the extension .3dm in the given directory
fileNames = glob.glob(iDirectoryName + "*.3dm")

for fileName in fileNames:
    file = File3dm.Read(fileName)
    
    ## Do Something useful with file, such as
    
    # Add a new layer
    
    layer = Layer()
    layer.Name = "MyNewLayer"
    file.AllLayers.Add(layer)
   
    # Bake a mesh into this file then save
    
    file.Objects.AddMesh(iGeometry)
    file.Write(fileName, 1)
# ---------- end python_3 ----------
