# Grasshopper definition Recursive2DBranching.gh (Grasshopper 1.0.7)

timer = Timer(TimerInterval=1000, Target=python)
python = GhPythonScript()  # -> out, oGeometry
# ---------- python: Python ----------
import Rhino.Geometry as rg
import random

lines = []

def MoveRecursively(startPoint, moveVector, currentStep):
    endPoint = startPoint + moveVector
    lines.append(rg.Line(startPoint, endPoint))
    
    if (currentStep >= 8): return # Terminate
    
    moveVector.Rotate(random.uniform(-0.3, 0.3), rg.Vector3d.ZAxis)
    MoveRecursively(endPoint, moveVector, currentStep + 1)
    
    moveVector.Rotate(random.uniform(-0.3, 0.3), rg.Vector3d.ZAxis)
    MoveRecursively(endPoint, moveVector, currentStep + 2)
# Main Script

MoveRecursively(rg.Point3d(0, 0, 0), rg.Vector3d(0.1, 0.1, 0.0), 0) 

oGeometry = lines
# ---------- end python ----------
