# Grasshopper definition ShortestConnection.gh (Grasshopper 1.0.7)

pt = Point([Point(-11.65724458, -2.457852772, 0), Point(-8.239658816, -0.07022436491, 0), Point(-14.23213796, 9.105759317, 0), Point(-3.838931948, 4.424134989, 0), Point(-15.30891155, 3.347361394, 0), Point(-0.6554274058, 1.661976636, 0), Point(-2.200363434, -13.55330243, 0), Point(-3.651666975, -0.5852030409, 0), Point(-8.520556276, -5.079562395, 0), Point(-16.85384758, 0.1638568515, 0), Point(-13.52989431, 0.2106730947, 0)])
python = GhPythonScript(iPoints=pt)  # -> out, oPoints; inputs iPoints: list of Point3d
# ---------- python: Python ----------
result = []
currentPoint = iPoints[0]
result.append(currentPoint)
del iPoints [0]

while len(iPoints) > 0:
    nearestIndex = 0
    
    for i in range(0, len(iPoints)):
        if iPoints[i].DistanceTo(currentPoint) < iPoints[nearestIndex].DistanceTo(currentPoint):
            nearestIndex = i
            
    currentPoint = iPoints[nearestIndex]
    result.append(currentPoint)
    del iPoints[nearestIndex]
 
oPoints = result
# ---------- end python ----------
pline = PolyLine(Vertices=python.oPoints, Closed=False)
