# Grasshopper definition SimpleMeshLineIntersection.gh (Grasshopper 1.0.7)

pt = Point(Point(-0.3130305149, -3.015578633, 1.793978288))
pt_2 = Point(Point(-0.2172297919, 3.642375676, 0))
mesh = Mesh(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)
ln = Line(StartPoint=pt, EndPoint=pt_2)
python = PythonScript(IMesh=mesh, ILine=ln)  # -> Out, IHitPoints
