# Grasshopper definition SimpleParticleSystem.gh (Grasshopper 1.0.7)

pt = Point([Point(-7.009860424, 23.03398134, 0), Point(11.26666211, 8.685732542, 0)])
timer = Timer(TimerInterval=1, Target=python)  # disabled
python = GhPythonScript(iReset=Button(), iJerkiness=Slider(0.5, range=0..1), iAttractors=pt)  # -> out, oGeometry; inputs iReset: Boolean, iAttractors: list of Point3d
# ---------- python: Python ----------
import Rhino.Geometry as rg
from Grasshopper.Kernel.Types import *
from System.Threading.Tasks import Parallel
import random
import time

import ghpythonlib.parallel as parallel


class ParticleSystem:
    
    def __init__(self, count):
        self.Particles = []
        for i in range(count):
            self.Particles.append(Particle())

    def Update(self):
        
        #for particle in self.Particles:
        #   particle.Update()
           
        parallel.run(lambda p : p.Update(), self.Particles, False)


    def GetDisplayPolylines(self):
        
        polylines = []
        
        for particle in self.Particles:
            polylines.append(GH_Curve(rg.PolylineCurve(particle.History)))
            
        return polylines

class Particle:
    
    def __init__(self):
        self.Position = rg.Point3d.Origin
        self.Velocity = rg.Vector3d(0.1, 0.1, 0.0)
        self.History = []
        
    def Update(self):
        self.Velocity.Rotate(random.uniform(-iJerkiness, iJerkiness), rg.Vector3d.ZAxis)
        
        closestAttractor = iAttractors[0]
        
        for attractor in iAttractors:
            if attractor.DistanceTo(self.Position) < closestAttractor.DistanceTo(self.Position):
                closestAttractor = attractor
        
        toAttractor = closestAttractor - self.Position
        toAttractor.Unitize()
        toAttractor *= 0.02
        
        self.Velocity += toAttractor
        self.Velocity.Unitize()
        self.Velocity *= 0.1
        
        self.Position += self.Velocity
        self.History.append(self.Position)
        
#Main Script:
    
if iReset or not ("particleSystem" in globals()): 
    particleSystem = ParticleSystem(5000)
else:
    startTime = time.time()
    particleSystem.Update()
    endTime = time.time()
    print endTime - startTime
    
# oGeometry = particleSystem.GetDisplayPolylines()
# ---------- end python ----------
panel = Panel(python.out)
