# Grasshopper definition TreeGrowth.gh (Grasshopper 1.0.7)

spreadvariation = Slider(0.27, range=0..0.3)
shrink = Slider(0.7, range=0..1)
shrinkvariation = Slider(0.13, range=0..1)
spreadvariation_2 = Slider(0.3, range=0..0.3)
shrink_2 = Slider(0.7, range=0..1)
shrinkvariation_2 = Slider(0.25, range=0..1)
spreadangle = Slider(0.55, range=0..0.6)
brep = Brep(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)
spreadangle_2 = Slider(0.33, range=0..0.6)
level = Slider(10, range=0..10)
level_2 = Slider(5, range=0..10)
popgeo = PopulateGeometry(Geometry=brep, Count=30, Seed=1)
Z = UnitZ(Factor="10")
Z_2 = UnitZ(Factor="10")
pt = Point(Point(0.1351901574, -0.2341630902, 0))
pt_2 = Point(popgeo)
python = PythonScript(
    iRootPosition=pt,
    iRootDirection=Z_2,
    iLevel=level_2,
    iSpreadAngle=spreadangle_2,
    iSpreadVariation=spreadvariation_2,
    iShrink=shrink_2,
    iShrinkVariation=shrinkvariation_2)  # -> out, branches; inputs iRootPosition: Point3d, iRootDirection: Vector3d; disabled
# ---------- python: Python ----------
import Rhino.Geometry as rg
import random
import rhinoscriptsyntax as rs

branches = []

def Branch(startPos, dir, levelRemained):
    endPos = startPos + dir
    branches.append(rs.AddLine((startPos.X, startPos.Y, startPos.Z), (endPos.X, endPos.Y, endPos.Z)))
    
    if (levelRemained > 0):
        normalPlane = rg.Plane(endPos, dir)
        normalPlane.Rotate(random.uniform(0, 3.14), normalPlane.ZAxis)

        leftBranchDir = rg.Vector3d(dir)
        leftBranchDir.Rotate(-iSpreadAngle - random.uniform(0, iSpreadVariation), normalPlane.XAxis)
        leftBranchDir *= iShrink + random.uniform(0, iShrinkVariation)
        Branch(endPos, leftBranchDir, levelRemained - 1)

        rightBranchDir = rg.Vector3d(dir)
        rightBranchDir.Rotate(iSpreadAngle + random.uniform(0, iSpreadVariation), normalPlane.XAxis)
        rightBranchDir *= iShrink + random.uniform(0, iShrinkVariation)

        rightBranchDir *= iShrink
        Branch(endPos, rightBranchDir, levelRemained - 1)

Branch(iRootPosition, iRootDirection, 10)
# ---------- end python ----------
pt_3 = Point(Point(-10.50932073, -146.6311404, 76.11677459))
point = Point(Point(1, 0, 0))
python_2 = PythonScript(
    iRootPosition=pt_2,
    iRootDirection=Z,
    iLevel=level,
    iSpreadAngle=spreadangle,
    iSpreadVariation=spreadvariation,
    iShrink=shrink,
    iShrinkVariation=shrinkvariation,
    iAttractor=pt_3,
    iAttractorStrength=Slider(1, range=0..1))  # -> out, oBranches; inputs iRootPosition: Point3d, iRootDirection: Vector3d, iAttractor: Point3d
# ---------- python_2: Python ----------
import Rhino.Geometry as rg
import random
branches = []

def ComputeBranch(startPos, dir, levelRemained):
    endPos = startPos + dir
    branches.append(rg.Line(startPos, endPos))
    
    if (levelRemained > 0 and random.uniform(0.0, 1.0) < 0.9):
        normalPlane = rg.Plane(endPos, dir)
        normalPlane.Rotate(random.uniform(0, 3.14), normalPlane.ZAxis)
        
        leftBranchDir = rg.Vector3d(dir)
        leftBranchDir.Rotate(-iSpreadAngle + random.uniform(0, iSpreadVariation), normalPlane.XAxis)
        leftBranchDir *= iShrink + random.uniform(0, iShrinkVariation)
        ComputeBranch(endPos, leftBranchDir, levelRemained - 1)

        rightBranchDir = rg.Vector3d(dir)
        rightBranchDir.Rotate(iSpreadAngle + random.uniform(0, iSpreadVariation), normalPlane.XAxis)
        rightBranchDir *= iShrink + random.uniform(0, iShrinkVariation)
        ComputeBranch(endPos, rightBranchDir, levelRemained - 1)

ComputeBranch(iRootPosition, iRootDirection, 10)

oBranches = branches
# ---------- end python_2 ----------
