# Grasshopper definition UVSurfaceToMesh.gh (Grasshopper 0.9.76)
# plug-ins: Python Interpreter

pt = Point([Point(-8, -12, 0), Point(-9.744231068, -1, 8.712464232), Point(-8, 11, 0)])
pt_2 = Point([Point(0.1453333915, -12, -4.200370007), Point(-0.561224943, -1, 0), Point(0.04462376078, 11, 5.316281991)])
pt_3 = Point([Point(7.456778476, -12, 0), Point(8.377067306, -1, -3.113435892), Point(7.520270272, 11, 3.973962414)])
entwine = Entwine(Branch00=pt, Branch01=pt_2, Branch02=pt_3, FlattenInputs=True)
intcrv = Interpolate(Vertices=entwine, Degree=3, Periodic=False, KnotStyle=1)  # -> flatten(Curve), Length, Domain
loft = Loft(Curves=intcrv.Curve, Options={Adjust=False, Closed=False, LoftEnds=0, LoftSimp=0, LoftType=0, Rebuild=10, Refit=0.01})
u_division = Slider(20, range=0..20)
v_division = Slider(20, range=0..20)
python = PythonScript(iSurface=loft, iUDivision=u_division, iVDivision=v_division)  # -> out, oGeometry; inputs iSurface: Surface, iUDivision: Int32, iVDivision: Int32
# ---------- python: Python ----------
import Rhino.Geometry as rg

iSurface.SetDomain(0, rg.Interval(0.0, 1.0))
iSurface.SetDomain(1, rg.Interval(0.0, 1.0))
# ---------- end python ----------
