# Grasshopper definition UVSurfaceToMesh_Completed.gh (Grasshopper 1.0.7)

pt = Point([Point(-8, -12, 0), Point(-9.744231068, -1, 7.613696427), Point(-8, 11, 0)])
pt_2 = Point([Point(0.1453333915, -12, -4.200370007), Point(-0.561224943, -1, 0), Point(0.04462376078, 11, 5.316281991)])
pt_3 = Point([Point(7.456778476, -12, 0), Point(8.377067306, -1, -3.113435892), Point(7.520270272, 11, 3.973962414)])
entwine = Entwine(Branch00=pt, Branch01=pt_2, Branch02=pt_3, FlattenInputs=True)
intcrv = Interpolate(Vertices=entwine, Degree=3, Periodic=False, KnotStyle=1)  # -> flatten(Curve), Length, Domain
u_division = Slider(20, range=0..20)
v_division = Slider(20, range=0..20)
loft = Loft(Curves=intcrv.Curve, Options={Adjust=False, Closed=False, LoftEnds=0, LoftSimp=0, LoftType=0, Rebuild=10, Refit=0.01})
python = PythonScript(iSurface=loft, iUDivision=u_division, iVDivision=v_division)  # -> out, oGeometry, oVertices, oNormals; inputs iSurface: Surface, iUDivision: Int32, iVDivision: Int32
# ---------- python: Python ----------
import Rhino.Geometry as rg

iSurface.SetDomain(0, rg.Interval(0.0, 1.0))
iSurface.SetDomain(1, rg.Interval(0.0, 1.0))

mesh = rg.Mesh() # First, Create an empty mesh object

# Create vertices for the mesh
for i in range(0, iUDivision + 1):
    for j in range(0, iVDivision + 1):
        u = i / iUDivision
        v = j / iVDivision
        mesh.Vertices.Add(iSurface.PointAt(u, v))

# This utility function compute the vertex index knowing the row and column indices
def GerVertexIndex(i, j):
    return i * (iVDivision + 1) + j

# Create the mesh faces. For each face, we need to obtain the indices of the four relevant vertices
for i in range(0, iUDivision):
    for j in range(0, iVDivision):
        v1 = GerVertexIndex(i, j) 
        v2 = GerVertexIndex(i + 1, j)
        v3 = GerVertexIndex(i + 1, j + 1)
        v4 = GerVertexIndex(i, j + 1)
        mesh.Faces.AddFace(v1, v2, v3, v4)
        
mesh.Normals.ComputeNormals()

oVertices = mesh.Vertices
oNormals = mesh.Normals

oGeometry = mesh # Finally, output the mesh, yay!!!
# ---------- end python ----------
vdis = VectorDisplay(Anchor=python.oVertices, Vector=python.oNormals)
