# Grasshopper definition UVSurfaceWithAttractorPattern.gh (Grasshopper 1.0.7)

pt = Point([Point(-8, -12, 0), Point(-9.744231068, -1, 8.712464232), Point(-8, 11, 0)])
pt_2 = Point([Point(0.1453333915, -12, -4.200370007), Point(-0.561224943, -1, 0), Point(0.04462376078, 11, 5.316281991)])
pt_3 = Point([Point(7.456778476, -12, 0), Point(8.377067306, -1, -3.113435892), Point(7.520270272, 11, 3.973962414)])
entwine = Entwine(Branch00=pt, Branch01=pt_2, Branch02=pt_3, FlattenInputs=True)
intcrv = Interpolate(Vertices=entwine, Degree=3, Periodic=False, KnotStyle=1)  # -> flatten(Curve), Length, Domain
pt_4 = Point([Point(20.24501941, -13.71334327, 0), Point(14.18104379, 3.045874709, 4.670365514), Point(10.96123891, 17.73519275, 0), Point(-1.152887255, 12.81141135, 7.13489577)])
loft = Loft(Curves=intcrv.Curve, Options={Adjust=False, Closed=False, LoftEnds=0, LoftSimp=0, LoftType=0, Rebuild=10, Refit=0.01})
pt_5 = Point(Point(-0.05803448647, 5.606844952, 8.730973758))
intcrv_2 = Interpolate(Vertices=pt_4, Degree=3, Periodic=False, KnotStyle=1)  # -> Curve, Length, Domain
pln = Plane(Plane(origin=(3.717607621, -5.140448384, 0), x=(0.9523066022, 0.3051428116, 0), y=(-0.3051239204, 0.9522476455, 0.01112721617)))
pln_2 = Plane(Plane(origin=(0.03884881733, -4.436637889, 0), x=(0.9182264656, -0.396055751, 0), y=(0.3723157439, 0.863186985, 0.3410120463)))
pln_3 = Plane(Plane(origin=(4.033668462, -1.918485484, 0), x=(0.6989175483, 0.7152022516, 0), y=(-0.6445505066, 0.6298744989, 0.4333736956)))
pln_4 = Plane(Plane(origin=(0.1868094282, -1.875914249, 0), x=(0.8452226202, 0.5344143733, 0), y=(0.3788871992, -0.5992429232, -0.705232167)))
python = GhPythonScript(
    iSurface=loft,
    iUDivision=Slider(20, range=1..20),
    iVDivision=Slider(19, range=1..20),
    iReferencePoint=pt_5,
    iReferenceCurve=intcrv_2.Curve,
    iFrameA=pln_2,
    iFrameB=pln,
    iFrameC=pln_3,
    iFrameD=pln_4)  # -> out, oGeometry; inputs iSurface: Surface, iUDivision: Int32, iVDivision: Int32, iReferencePoint: Point3d, iReferenceCurve: Curve, iFrameA: Plane, iFrameB: Plane, iFrameC: Plane, iFrameD: Plane
# ---------- python: Python ----------
import Rhino.Geometry as rg

iSurface.SetDomain(0, rg.Interval(0.0, 1.0))
iSurface.SetDomain(1, rg.Interval(0.0, 1.0))

def CreateTriangleSurface(A, B, C):
    CB = rg.LineCurve(C, B)
    BA = rg.LineCurve(B, A)
    AC = rg.LineCurve(A, C)
    return rg.Brep.CreateEdgeSurface([CB, BA, AC])
 
def CreateComponentSurfaces(frameA, frameB, frameC, frameD, height):
    z = frameA.ZAxis + frameB.ZAxis + frameC.ZAxis + frameD.ZAxis
    z.Unitize()
    centerBottom = 0.25 * (frameA.Origin + frameB.Origin + frameC.Origin + frameD.Origin)
    top = centerBottom + height * z
    
    surface1 = CreateTriangleSurface(frameA.Origin, frameB.Origin, top)
    surface2 = CreateTriangleSurface(frameB.Origin, frameC.Origin, top)
    surface3 = CreateTriangleSurface(frameC.Origin, frameD.Origin, top)
    surface4 = CreateTriangleSurface(frameD.Origin, frameA.Origin, top)
    return [surface1, surface2, surface3, surface4]
        
allSurfaces = []

for i in range(0, iUDivision):
    for j in range(0, iVDivision):
        frameA = iSurface.FrameAt(i / iUDivision, j / iVDivision)[1]
        frameB = iSurface.FrameAt((i + 1) / iUDivision, j / iVDivision)[1]
        frameC = iSurface.FrameAt((i + 1) / iUDivision, (j + 1) / iVDivision)[1]
        frameD = iSurface.FrameAt(i / iUDivision, (j + 1) / iVDivision)[1]
        
        distance = frameA.Origin.DistanceTo(iReferencePoint)
        height = 20 / (distance + 1) 
        componentSurfaces = CreateComponentSurfaces(frameA, frameB, frameC, frameD, height)
        allSurfaces.extend(componentSurfaces)
        
oGeometry = allSurfaces
# ---------- end python ----------
colour = ColourPicker(PickedColour=RGB(237, 237, 237))
preview = CustomPreview(Geometry=python.oGeometry, Material=colour)
