# Grasshopper definition VertexColors.gh (Grasshopper 1.0.7)

inflate_distancce = Slider(0.282, range=0..0.3)
mesh = Mesh(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)
python = PythonScript(iMesh=mesh, iInflateDistance=inflate_distancce)  # -> out, oGeometry; inputs iMesh: Mesh
# ---------- python: Python ----------
import Rhino.Geometry as rg

for i in range(iMesh.Vertices.Count):
    # Notice that we have to "convert" from Point3f to Point3d
    position = rg.Point3d(iMesh.Vertices[i])
    
    # Notice that we have to "convert" from Vector3f to Vector3d
    normal = rg.Vector3d(iMesh.Normals[i])
    
    # The reason for the "conversion" is because Point3f and  Vector3d does not support math operators (e.g. + or *)
    newPosition = position + normal * iInflateDistance
    
    iMesh.Vertices.SetVertex(i, newPosition)

oGeometry = iMesh
# ---------- end python ----------
python_2 = PythonScript(iMesh=mesh)  # -> out, oMesh; inputs iMesh: Mesh
# ---------- python_2: Python ----------
import Rhino.Geometry as rg
from System.Drawing import Color
import random

for i in range(iMesh.Vertices.Count):
    red = iMesh.Vertices[i].Z / 3.0 * 255
    if red > 255:
        red = 255
    elif red < 0:
        red = 0
    randomColor = Color.FromArgb(255, red, 0, 0)
    iMesh.VertexColors.SetColor(i, randomColor)
    
oMesh = iMesh
# ---------- end python_2 ----------
