# Grasshopper definition WanderingParticles.gh (Grasshopper 1.0.7)

timer = Timer(TimerInterval=1, Target=ghpython_script)
point = Point(Point(-2.568865138, 13.48710024, 0))
point_2 = Point([Point(4, 6, 0), Point(7, 7, 0), Point(10, 4, 0), Point(6, 4, 0), Point(7, 5, 0), Point(10, 6, 0), Point(11, 5, 0), Point(9, 7, 0)])
ghpython_script = GhPythonScript(iReset=Button(), iInitialPositions=point_2, iTarget=point)  # -> out, oGeometry; inputs iReset: Boolean, iInitialPositions: list of Point3d, iTarget: Point3d
# ---------- ghpython_script: Python ----------
import Rhino.Geometry as rg
import random

class Particle:

    def __init__(self):
        self.Position = rg.Point3d.Origin
        self.Velocity = rg.Vector3d(0.1, 0.1, 0.0)
        self.History = [self.Position]
    
    def Update(self):
        self.Velocity.Rotate(random.uniform(-0.2, 0.2), rg.Vector3d.ZAxis)
        
        toTarget = iTarget - self.Position
        toTarget.Unitize()
        toTarget *= 0.003
        
        self.Velocity += toTarget
        self.Velocity.Unitize()
        self.Velocity *= 0.1
        
        if self.Position.X > 20:
            self.Position = rg.Point3d(20, self.Position.Y, self.Position.Z) 
            self.Velocity = rg.Vector3d(-self.Velocity.X, self.Velocity.Y, self.Velocity.Z)
        
        self.Position += self.Velocity
        self.History.append(self.Position)

# Main Script:

if iReset:
    particles = []
    for i in range(30):
        particles.append(Particle())
    
else:
    for particle in particles:
        particle.Update()

paths = []

for particle in particles:
    paths.append(rg.PolylineCurve(particle.History))

oGeometry = paths
# ---------- end ghpython_script ----------
