# Grasshopper definition WanderingParticles_Completed.gh (Grasshopper 1.0.7)
# plug-ins: Kangaroo2 Components

line = Line(Line((2.648873856, 3.359032037, 0), (11.63150577, 11.49765827, 0)))
length_line = LengthLine(Line=line, Length=Slider(4, range=0..10), Strength=10)
python = GhPythonScript()  # -> out, a
# ---------- python: Python ----------
import Rhino.Geometry as rg

import clr
clr.AddReferenceToFileAndPath(r"C:\Program Files\Rhino 6\Plug-ins\Grasshopper\Components\KangarooSolver.dll")

from KangarooSolver.Goals import Spring, Anchor, Unary


points = []

for i in range(10):
    points.append(rg.Point3d(i, 10, 0))
    
allGoals = []

for i in range(len(points) - 1):
    springGoal = Spring(points[i], points[i + 1], 0.7, 1.0)
    allGoals.append(springGoal)
    
for point in points:
    unaryGoal = Unary(point, rg.Vector3d(0, -0.4, 0))
    allGoals.append(unaryGoal)
    
allGoals.append(Anchor(points[0], 1000))
allGoals.append(Anchor(points[-1], 1000))


a = allGoals
# ---------- end python ----------
panel = Panel(python.a)
bouncysolver = BouncySolver(GoalObjects=python.a, Reset=Button(), Threshold=1e-15, Tolerance=0.01, Damping=0.99, Iterations=1, On=Toggle(True))  # -> I, V, O
